# Grasshopper definition LLF_pav_lines.gh (Grasshopper 1.0.7)
# plug-ins: Kangaroo2 Components

center = GetNumber(Slider(15, range=15..30), AtLeast=1, AtMost=1, Maximum=1.797693135e+308, Minimum=-1.797693135e+308)
end = GetNumber(Slider(28, range=15..30), AtLeast=1, AtMost=1, Maximum=1.797693135e+308, Minimum=-1.797693135e+308)
collision = GetNumber(Slider(6, range=1..6), AtLeast=1, AtMost=1, Maximum=1.797693135e+308, Minimum=-1.797693135e+308)
# #188
# https://www.youtube.com/watch?v=XAMgFA8Qx84&list=PLVXPjkEqtNTdMER5dtfyBBdI0AZYz3em7&index=2&ab_channel=GH.parametricdesign
skin = GetNumber(Slider(1.3, range=0.8..1.3), AtLeast=1, AtMost=1, Maximum=1.797693135e+308, Minimum=-1.797693135e+308)
range = Range(Domain=Domain(0, 1), Steps=collision)
range_2 = Range(Domain="100", Steps=collision)
graph_mapper = GraphMapper(range, x0=0, x1=1, y0=0, y1=1, container_name="Sine", Equation_px=[0, 0.3306066394], Equation_py=[0, 1])
construct_domain = ConstructDomain(DomainStart=center, DomainEnd=end)
bounds = Bounds(Numbers=graph_mapper)
remap_numbers = RemapNumbers(Value=graph_mapper, Source=bounds, Target=construct_domain)  # -> Mapped, Clipped
construct_point = ConstructPoint(XCoordinate=remap_numbers.Mapped, YCoordinate=range_2, ZCoordinate=0)
nurbs_curve = NurbsCurve(Vertices=construct_point, Degree=3, Periodic=False)  # -> Curve, Length, Domain
perp_frames = PerpFrames(Curve=nurbs_curve.Curve, Count=collision, Align=True)  # -> Frames, Parameters
circle = Circle(Plane=perp_frames.Frames, Radius=remap_numbers.Mapped)
list_item = ListItem(List=circle, Index="0", Wrap=True)
shift_list = ShiftList(List=circle, Shift=1, Wrap=invert(True))
shortest_list = ShortestList(ListListA=circle, ListListB=shift_list, TrimMode=2)  # -> ListListA, ListListB
tween_curve = TweenCurve(CurveA=shortest_list.ListListA, CurveB=shortest_list.ListListB, Factor=0.5, BlendType=0)
area = Area(Geometry=tween_curve)  # -> Area, Centroid
scale = Scale(Geometry=tween_curve, Center=area.Centroid, Factor=skin)  # -> Geometry, Transform
loft_options = LoftOptions(Closed=False, Adjust=False, Rebuild=0, Refit=0, Type="2")
merge = Merge(Data1=graft(shortest_list.ListListA), Data2=graft(scale.Geometry), Data3=graft(shortest_list.ListListB))
loft = Loft(Curves=merge, Options=loft_options)  # -> flatten(Loft)
mirror = Mirror(Geometry=loft, Plane=list_item)  # -> Geometry, Transform
rectangle = Rectangle(Plane=PlaneXY(-125, -125, 0), XSize=Domain(0, 250), YSize=Domain(0, 250), Radius=0)  # -> Rectangle, Length
merge_2 = Merge(Data1=mirror.Geometry, Data2=loft)
brep_join = BrepJoin(Breps=flatten(merge_2))  # -> Breps, Closed
box_rectangle = BoxRectangle(Rectangle=rectangle.Rectangle, Height="-50")
split_brep = SplitBrep(Brep=brep_join.Breps, Cutter=box_rectangle)
dispatch = Dispatch(List=split_brep, DispatchPattern=[True, False])  # -> ListA, ListB
quad_remesh = QuadRemesh(Mesh=dispatch.ListA, Settings={aqc=True, as=50, dhe=True, gci=0, null=False, pme=0, sa=0, tqc=2000})
mesh = Mesh(quad_remesh)
clean = CombineClean(Meshes=mesh)
medges = MeshEdges(Mesh=clean)  # -> NakedEdges, InteriorEdges, NonManifoldEdges
join = JoinCurves(Curves=medges.NakedEdges, Preserve=False)
join_2 = JoinCurves(Curves=medges.InteriorEdges, Preserve=False)
merge_3 = Merge(Data1=join, Data2=join_2)  # -> flatten(Result)
pt = ConstructPoint(XCoordinate=0, YCoordinate=0, ZCoordinate=0)
curvepoint = PointOnCurve(merge_3, parameter=0.5)
pull = PullPoint(Point=curvepoint, Geometry=pt, ClosestOnly=True)  # -> ClosestPoint, Distance
bnd = Bounds(Numbers=pull.Distance)
remap = RemapNumbers(Value=pull.Distance, Source=bnd, Target=Domain(0, 1))  # -> Mapped, Clipped
gradient = Gradient(
    LowerLimit=0,
    UpperLimit=1,
    Parameter=remap.Mapped,
    stops=[0: RGB(255, 242, 0), 0.465: RGB(255, 0, 115), 0.859: RGB(60, 0, 199)])
c_script = CSharpScript(crv=merge_3, color=gradient)  # -> out, A; inputs crv: Curve, color: Color
# ---------- c_script: C# ----------
    var c = color.R + "," + color.G + "," + color.B;
    crv.SetUserString("color", c);
    A = crv;
# ---------- end c_script ----------

# ---- group: RH_OUT:edges
# beams
# connections
# vertex
curve = Curve(flatten(c_script.A))
